# Grasshopper definition TextToRobot001 [Apr-24 '19, 0744].gh (Grasshopper 1.0.7)
# plug-ins: Machina

# ----
# Information: # Write-text-with-universal-robot
# Grasshopper definition that creates UR-script code from text located on a plane in space. The code can be exported to a file and transferred to the robot via usb or directly sent to the robot.
# Uses the Machina-Grasshopper-Plugin to communicate with the robot.
# 
# Use at your own Risk.
# All Components Used: DATE- 2021.01.19 TIME- 10:32h
# Last saved by - HP
# Total Components - 158
# Vector:
# ...Plane:
# ......Flip Plane - 2
# ......Deconstruct Plane - 1
# ......Plane Normal - 1
# ......Plane 3Pt - 1
# ...Vector:
# ......Amplitude - 1
# ...Point:
# ......Construct Point - 3
# Params:
# ...Geometry:
# ......Plane - 14
# ......Vector - 2
# ......Curve - 9
# ......Point - 5
# ......Rectangle - 2
# ...Primitive:
# ......Text - 2
# ......Number - 11
# ......Data - 5
# ......Boolean - 2
# ...Util:
# ......Data Recorder - 1
# ......Jump - 14
# ...Input:
# ......Panel - 36
# ......Button - 3
# ......Boolean Toggle - 11
# ......Number Slider - 5
# ......Font - 1
# Curve:
# ...Primitive:
# ......Rectangle 3Pt - 1
# ...Util:
# ......Fillet - 1
# ......Explode - 1
# ......Curve To Polyline - 1
# ...Spline:
# ......PolyLine - 1
# Transform:
# ...Euclidean:
# ......Orient - 1
# ......Move - 1
# Maths:
# ...Script:
# ......Python Script - 1
# ......C# Script - 1
# OTools:
# ...3 | Debugging:
# ......OTools_GetComponents2 - 1
# Machina:
# ...Program:
# ......DisplayProgram - 1
# ......CompileProgram - 1
# ...Robot:
# ......CreateRobot - 1
# ...Action:
# ......TransformTo - 1
# ......SpeedTo - 1
# ......PrecisionTo - 1
# ......AxesTo - 2
# ...Bridge:
# ......Listen - 1
# ......ActionExecuted - 1
# ......Connect - 1
# ......Send - 1
# Sets:
# ...List:
# ......List Length - 1
# ......List Item - 1
# ......Insert Items - 1
# ...Tree:
# ......Merge - 1
update_component_list = Button()
plugins_used = Panel("Machina 0.8.12")
o_getcomps2 = OTools_GetComponents2(x=update_component_list)  # inputs x: Boolean; plug-in component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

# ---- group: Text
text_size = Slider(43.292, range=0.1..200)
bold = BooleanToggle(False)
text_to_write = Panel("Test")
font = Font({"", "Arial", "Arial Black", "Bahnschrift", "Bahnschrift ...": "Bahnschrift Condensed", "Bahnschrift ...": "Bahnschrift Light", "Bahnschrift ...": "Bahnschrift Light Condensed", "Bahnschrift ...": "Bahnschrift Light SemiCondensed", "Bahnschrift ...": "Bahnschrift SemiBold", "Bahnschrift ...": "Bahnschrift SemiBold Condensed"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}, selected="Comic Sans MS")
number = Number(text_size)
text = Text(text_to_write)

# ---- group: Robot Settings
move_height = Slider(17.71, range=0..50)
text_to_polyline_tolerance = Slider(10, range=0.0001..10)
robot_speed = Slider(56, range=0..200)
robot_soft_radius = Slider(1.673, range=0..20)
number_2 = Number(text_to_polyline_tolerance)
number_3 = Number(robot_speed)
number_4 = Number(robot_soft_radius)
number_5 = Number(move_height)

# ---- group: Define Writing space / Top right
x_coordinate = Panel("65")
y_coordinate = Panel("796")
z_coordinate = Panel("184")
construct_point = ConstructPoint(XCoordinate=x_coordinate, YCoordinate=y_coordinate, ZCoordinate=z_coordinate)
tr_point = Point(construct_point)

# ---- group: Define Writing space / Top left
# To Do: - Cut off all text outside of the writing area
# - check for inclusion
# - best-practicise
x_coordinate_2 = Panel("-426")
y_coordinate_2 = Panel("796")
z_coordinate_2 = Panel("184")
construct_point_2 = ConstructPoint(XCoordinate=x_coordinate_2, YCoordinate=y_coordinate_2, ZCoordinate=z_coordinate_2)
tl_point = Point(construct_point_2)

# ---- group: Define Writing space / bottom right
y_coordinate_3 = Panel("516")
x_coordinate_3 = Panel("65")
z_coordinate_3 = Panel("178")
construct_point_3 = ConstructPoint(XCoordinate=x_coordinate_3, YCoordinate=y_coordinate_3, ZCoordinate=z_coordinate_3)
br_point = Point(construct_point_3)

# ---- group: Create writing area
plane_3pt = Plane3Pt(PointA=tl_point, PointB=tr_point, PointC=br_point)
rectangle_3pt = Rectangle3Pt(PointA=tl_point, PointB=tr_point, PointC=br_point)  # -> Rectangle, Length
plane = Plane(plane_3pt)
flip_plane = FlipPlane(Plane=plane, ReverseX=Toggle(False), ReverseY=Toggle(True), SwapAxes=Toggle(False))
flip_plane_2 = FlipPlane(Plane=plane, ReverseX=Toggle(False), ReverseY=Toggle(True), SwapAxes=Toggle(False))
writing_area_rectangle = Rectangle(rectangle_3pt.Rectangle)
writing_plane = Plane(flip_plane)
text_plane = Plane(flip_plane_2)

# ---- group: Create curves from text input
panel = Panel(text)
panel_2 = Panel(font)
bold_2 = Boolean(bold)
textsize = Number(number)
origin = Point(Point(0.007074401231, -0.02634070152, 0))
c_script = CSharpScript(face=panel_2, bold=bold_2, size=textsize, content=panel, pl=origin)  # -> out, A; inputs face: String, bold: Boolean, italics: Boolean, size: Double, content: String, pl: Plane
# ---------- c_script: C# ----------
    if(size == 0)
      size = 1;

    if(!string.IsNullOrEmpty(face) && size > 0 && !string.IsNullOrEmpty(content) &&
      pl.IsValid)
    {

      var te = RhinoDoc.ActiveDoc.Objects.AddText(content, pl, size, face, bold, italics);
      Rhino.DocObjects.TextObject txt = RhinoDoc.ActiveDoc.Objects.Find(te) as Rhino.DocObjects.TextObject;

      if(txt != null)
      {
        var tt = txt.Geometry as Rhino.Geometry.TextEntity;
        A = tt.Explode();
      }
      
      RhinoDoc.ActiveDoc.Objects.Delete(te, true);
    }
# ---------- end c_script ----------
curve = Curve(c_script.A)

# ---- group: Orient flat text to writing plane
curve_2 = Curve(curve)
plane_2 = Plane(text_plane)
orient = Orient(Geometry=curve_2, Source=PlaneXY(0, 0, 0), Target=plane_2)  # -> Geometry, Transform
curve_3 = Curve(orient.Geometry)

# ---- group: Create planes from curves
writing_plane_2 = Plane(writing_plane)
number_6 = Number(number_2)
curve_4 = Curve(curve_3)
curve_to_polyline = CurveToPolyline(Curve=curve_4, ToleranceDistance=number_6, ToleranceAngle=0)  # -> Polyline, Segments
dcnstrct_plane = DeconstructPlane(Plane=writing_plane_2)  # -> Origin, XAxis, YAxis, ZAxis
explode = Explode(Curve=curve_to_polyline.Polyline, Recursive=True)  # -> Segments, Vertices
plane_normal = PlaneNormal(Origin=explode.Vertices, ZAxis=dcnstrct_plane.ZAxis)
writing_plane_z_vector = Vector(dcnstrct_plane.ZAxis)
text_curves = Curve(curve_to_polyline.Polyline)
text_planes = Plane(plane_normal)

# ---- group: Create individual Robot Actions
panel_3 = Panel("0")
axesto = AxesTo(A1="-90", A2="-90", A3="-90", A4="-90", A5="90", A6="90", Relative=False)

# ----
axesto_2 = AxesTo(A1="-90", A2="-90", A3="-90", A4="-90", A5="120", A6="120", Relative=False)

# ---- group: Programm export
txt_filename = Panel("20190416_ Robota")
export_button = Button()

# ---- group: Geometry to verify
flat_text = Curve(curve)
text_in_position = Curve(text_curves)
writing_surface = Rectangle(writing_area_rectangle)
text_planes_2 = Plane(text_planes)

# ---- group: Export all commands to a .txt file
filename = Text(txt_filename)
boolean = Boolean(export_button)

# ---- group: Create Text Planes and offset Planes / Create offset Planes for non-writing moves
writing_plane_z_vector_2 = Vector(writing_plane_z_vector)
non_writing_height = Number(number_5)
amplitude = Amplitude(Vector=writing_plane_z_vector_2, Amplitude=expr("x*-1", non_writing_height))

# ---- group: Create Text Planes and offset Planes
first_and_last_list_index = Panel("""0
-1""")
text_planes_3 = Plane(plane_normal)

# ---- group: Create Text Planes and offset Planes / Create offset Planes for non-writing moves (continued)
list_item = ListItem(List=text_planes_3, Index=first_and_last_list_index, Wrap=True)
move = Move(Geometry=list_item, Motion=amplitude)  # -> Geometry, Transform

# ---- group: Create Text Planes and offset Planes (continued)
insert_items = InsertItems(List=text_planes_3, Item=move.Geometry, Indices=first_and_last_list_index, Wrap=True)
text_offset_planes = Plane(insert_items)
offset_plane = Plane(move.Geometry)

# ---- group: Create individual Robot Actions
number_7 = Number(number_3)
number_8 = Number(number_4)
planes = Plane(text_offset_planes)
transformto = TransformTo(Plane=planes, Relative=False)  # -> flatten(Action)
precisionto = PrecisionTo(Radius=number_8, Relative=False)
speedto = SpeedTo(Speed=number_7, Relative=False)

# ---- group: Visualise all Movement
number_9 = Number(number_4)
point = Point(text_offset_planes)
polyline = PolyLine(Vertices=flatten(point), Closed=False)
fillet = Fillet(Curve=polyline, Radius=number_9)
movement_lines = Curve(fillet)

# ---- group: Geometry to verify (continued)
movement_lines_2 = Curve(movement_lines)

# ---- group: Concatenate all Actions into a Program
merge = Merge(Data1=speedto, Data2=precisionto, Data3=axesto, Data4=transformto)
data = Data(merge)
displayprogram = DisplayProgram(Actions=data)
panel_5 = Panel(displayprogram)

# ---- group: Stream the program directly to the robot via the Machina Bridge
# Check these tutorials on how to set up real-time control with your machine: https://www.youtube.com/playlist?list=PLvxxYImPCApXj3tHVKmpTS_AuMPngnA47
connect_to_bridge = BooleanToggle(True)
send_program_to_bridge = Button()
data_2 = Data(data)
connect = Connect(URL="ws://127.0.0.1:6999/Bridge", Name="Grasshopper", Connect=connect_to_bridge)  # -> Status, Bridge
send = Send(Bridge=connect.Bridge, Actions=data_2, Send=send_program_to_bridge)  # -> Sent, Instructions
panel_6 = Panel(connect.Status)
panel_7 = Panel(send.Sent)
listen = Listen(Bridge=connect.Bridge, Autoupdate=True, Interval=66)
panel_8 = Panel(send.Instructions)
actionexecuted = ActionExecuted(BridgeMessage=listen)  # -> LastAction, ActionTCP, ActionAxes, ActionExternalAxes, PendingActions, PendingActionsOnDevice
panel_9 = Panel(actionexecuted.LastAction)
plane_3 = Plane(actionexecuted.ActionTCP)
panel_10 = Panel(actionexecuted.PendingActions)
data_recorder = DataRecorder(plane_3, DataLimit=-10, RecordData=True)
plane_4 = Plane(data_recorder)

# ---- group: Generate Robot Program
data_3 = Data(data)
createrobot = CreateRobot(Name="laURi", Brand="UR")
compileprogram = CompileProgram(Robot=createrobot, Actions=data_3, InLineTargets=Toggle(True), Comments=Toggle(False))
program_code = Data(compileprogram)

# ---- group: Export all commands to a .txt file (continued)
robot_program = Data(program_code)
panel_11 = Panel(robot_program)
txtwrite = PythonScript(Data=panel_11, Name=filename, Write=boolean, Reset=Toggle(False))  # inputs Data: list, Write: Boolean, Reset: Boolean
# ---------- txtwrite: Python ----------
import os
from scriptcontext import sticky as st

# Add a counter variable to sticky
if "count" not in st or Reset:
    st["count"] = 0
    
if Write:
    
    # Use the ghenv variable to get current GH file path
    filePath = ghenv.LocalScope.ghdoc.Path
    fileName = ghenv.LocalScope.ghdoc.Name
    filePath = filePath.replace(".gh","*")
    filePath = filePath.replace(fileName,"")
    
    # Add file name, count and extension
    filePath = os.path.join(filePath,Name + "_" + str(st["count"]) + ".txt")
    
    # Open file
    fileWrite = open(filePath,"w")
    
    # Write text data to file
    for line in Data:
        fileWrite.write(line + "\n")
        
    # Close file
    fileWrite.close()
    
    # Increment count
    st["count"] += 1
# ---------- end txtwrite ----------

# ---- group: Stream code to file: right-click on panel and stream contents to a text file in your system
panel_12 = Panel(program_code)

# ---- group: Length of the program
list_length = ListLength(List=panel_5)
commands = Panel(list_length)

# ---- group: Programm export (continued)
commands_2 = Panel(commands)
